# Grasshopper definition gh_to_b3d_MoveCamera_on_3DPath.ghx (Grasshopper 0.9.76)
# plug-ins: GH_CPython

crv = Curve(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)
reb = RebuildCurve(Curve=crv, Count=10, Tangents=False)  # disabled
crv_2 = Curve(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)  # disabled

crv_3 = Curve(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)
end = EndPoints(Curve=crv_3)  # -> Start, End

end_2 = EndPoints(Curve=crv)  # -> Start, End
divide = DivideCurve(Curve=crv, Count=Slider(360, range=0..1000), Kinks=False)  # -> Points, Tangents, Parameters
shift = ShiftList(List=divide.Points, Shift=1, Wrap=True)
ln = Line(StartPoint=divide.Points, EndPoint=shift)
viewer = ParamViewer(divide.Points)
Z = UnitZ(Factor=1)
item = ListItem(List=divide.Points, Index=Slider(202, range=0..359), Wrap=True)
end_3 = EndPoints(Curve=ln)  # -> Start, End
ln_2 = Line(StartPoint=divide.Points, EndPoint=shift)
xy = XYPlane(Origin=Point(0, 0, 0))
move = Move(Geometry=end_3.Start, Motion=Z)  # -> Geometry, Transform
panel = Panel(item)
sph = Sphere(Base=item, Radius=Slider(0.1, range=0..0.1))
vec2pt = Vector2Pt(PointA=end_3.Start, PointB=end_3.End, Unitize=False)  # -> Vector, Length
devec = DeconstructVector(Vector=vec2pt.Vector)  # -> XComponent, YComponent, ZComponent
project = Project(Geometry=ln_2, Plane=xy)  # -> Geometry, Transform
vec = VectorXYZ(XComponent=devec.XComponent, YComponent=devec.YComponent, ZComponent=0)  # -> Vector, Length
move_2 = Move(Geometry=end_3.Start, Motion=vec.Vector)  # -> Geometry, Transform
pl_3pt = Plane3Pt(PointA=end_3.Start, PointB=move.Geometry, PointC=move_2.Geometry)
end_4 = EndPoints(Curve=ln_2)  # -> Start, End
end_5 = EndPoints(Curve=project.Geometry)  # -> Start, End
ln_3 = Line(StartPoint=end_3.Start, EndPoint=move_2.Geometry)
X = UnitX(Factor=1)
move_3 = Move(Geometry=end_5.Start, Motion=X)  # -> Geometry, Transform
angle = Angle(VectorA=ln_3, VectorB=ln, Plane=pl_3pt)  # -> Angle, Reflex
ln_4 = Line(StartPoint=end_5.Start, EndPoint=end_5.End)
ln_5 = Line(StartPoint=end_5.Start, EndPoint=move_3.Geometry)
xy_2 = XYPlane(Origin=end_5.Start)
pdecon = Deconstruct(Point=divide.Points)  # -> XComponent, YComponent, ZComponent
deg = Degrees(Radians=angle.Angle)
brep = Brep(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)
debrep = DeconstructBrep(Brep=brep)  # -> Faces, graft(Edges), Vertices
angle_2 = Angle(VectorA=ln_5, VectorB=ln_4, Plane=xy_2)  # -> Angle, Reflex
bnd = Bounds(Numbers=deg)
item_2 = ListItem(List=debrep.Vertices, Index="2", Wrap=True)
deg_2 = Degrees(Radians=angle_2.Angle)
vec2pt_2 = Vector2Pt(PointA=item_2, PointB=end_4.Start, Unitize=False)  # -> Vector, Length
move_4 = Move(Geometry=debrep.Edges, Motion=vec2pt_2.Vector)  # -> Geometry, Transform
panel_2 = Panel(bnd)
xy_3 = XYPlane(Origin=end_4.Start)
addition = Addition(A=Slider(90, range=0..100), B=deg)
subtraction = Subtraction(A=deg_2, B=deg_2)
rotate = Rotate(Geometry=move_4.Geometry, Angle=angle_2.Angle, Plane=xy_3)  # -> Geometry, Transform
item_3 = ListItem(List=rotate.Geometry, Index=Slider(164, range=0..359), Wrap=True)

# ---- group: Z-rot
num = Number(deg_2)

# ----
viewer_2 = ParamViewer(num)

# ---- group: Y-rot
num_2 = Number(subtraction)

# ---- group: X-rot
num_3 = Number(addition)

# ----
gh_cpython = GH_CPython(
    x=pdecon.XComponent,
    y=pdecon.YComponent,
    z=pdecon.ZComponent,
    x_Rot=num_3,
    y_Rot=num_2,
    z_Rot=num,
    path_out="181105",
    TF=Button())  # -> output; inputs x: list, y: list, z: list, x_Rot: list, y_Rot: list, z_Rot: list, path_out: list, TF: list
#   port path_out: [required] - [type = int] - [default = None] Descripe your input here * bullet point. * bullet point
#   port output: indicate your output description here. refers to a new line.
# ---------- gh_cpython: Python ----------
import math
a= []


path = "C:\Users\yoshioca\Desktop\\" + str(path_out) + ".csv"

for i in xrange(len(x)):
    pos = str(x[i]) + ", " +  str(y[i]) + ", " + str(z[i]) + ", "
    rot = str(x_Rot[i]) + ", " + str(y_Rot[i]) + "," + str(z_Rot[i])
    temp = pos + rot
    a.append(temp)
    if i < len(x)-1:
        a.append("\n")

# print(path)

if TF:
    f = open(path, "w")
    f.writelines(a)
    f.close
# ---------- end gh_cpython ----------
